% Simulink data dictionary robotDataDictionary.sldd

jointVelBus = Simulink.Bus()  % Bus defining velocity (in degrees per second) for the joints of the robot
  upperArmJointVel: double, Unit="deg/s"  % Trajectory for upper arm joint
  foreArmJointVel: double, Unit="deg/s"  % Trajectory for fore arm joint
  wristJointVel: double, Unit="deg/s"  % Trajectory for wrist joint
  gripperJointVel: double, Unit="deg/s"  % Trajectory for gripper joint
  rightFingerJointVel: double, Unit="deg/s"  % Trajectory for right finger joint
  leftFingerJointVel: double, Unit="deg/s"  % Trajectory for left finger joint

motorCurrentBus = Simulink.Bus()  % Bus defining current (in Ampere) for the motors driving the joints of the robot
  upperArmJointCurrent: double, Unit="A"  % Current for upper arm joint motor.
  foreArmJointCurrent: double, Unit="A"  % Current for fore arm joint motor.
  wristJointCurrent: double, Unit="A"  % Current for wrist joint motor.
  gripperJointCurrent: double, Unit="A"  % Current for gripper joint motor.
  rightFingerJointCurrent: double, Unit="A"  % Current for right finger joint motor.
  leftFingerJointCurrent: double, Unit="A"  % Current for left finger joint motor.

motorVoltageBus = Simulink.Bus()  % Bus defining voltages (in Volt) for the motor drivers
  upperArmJointVoltage: double, Unit="V"  % Voltage for upper arm joint motor.
  foreArmJointVoltage: double, Unit="V"  % Voltage for fore arm joint motor.
  wristJointVoltage: double, Unit="V"  % Voltage for wrist joint motor.
  gripperJointVoltage: double, Unit="V"  % Voltage for gripper joint motor.
  rightFingerJointVoltage: double, Unit="V"  % Voltage for right finger joint motor.
  leftFingerJointVoltage: double, Unit="V"  % Voltage for left finger joint motor.

tsMax = 0.0025
ts = 0.0025

jointMotionBus = Simulink.Bus()  % Bus defining motion (in degrees) for the joints of the robot
  upperArmJointMotion: double, Unit="deg"  % Trajectory for upper arm joint
  foreArmJointMotion: double, Unit="deg"  % Trajectory for fore arm joint
  wristJointMotion: double, Unit="deg"  % Trajectory for wrist joint
  gripperJointMotion: double, Unit="deg"  % Trajectory for gripper joint
  rightFingerJointMotion: double, Unit="deg"  % Trajectory for right finger joint
  leftFingerJointMotion: double, Unit="deg"  % Trajectory for left finger joint

jointTorqueBus = Simulink.Bus()  % Bus defining torque (in N*m) for the joints of the robot
  upperArmJointTorque: double, Unit="N*m"  % Torque for upper arm joint
  foreArmJointTorque: double, Unit="N*m"  % Torque for fore arm joint
  wristJointTorque: double, Unit="N*m"  % Torque for wrist joint
  gripperJointTorque: double, Unit="N*m"  % Torque for gripper joint
  rightFingerJointTorque: double, Unit="N*m"  % Torque for right finger joint
  leftFingerJointTorque: double, Unit="N*m"  % Torque for left finger joint