test file "closedLoopTest"

suite "closedLoop_tuned"

  case "convergence test" [simulation]
    description: This test checks whether the error between the reference position and the actual position is within certain bounds
    model closedLoop_tuned, harness closedLoop_Harness, mode Accelerator

  case "temporal assessment test" [simulation]
    description: This test checks whether the current is within certain bounds and, if not, how long the maximum values are exceeded
    model closedLoop_tuned, harness closedLoop_tuned_temporalAssessments_Harness, mode Accelerator
    signal scenario: jointMotion
    assessment "currentMaxThreshold": At any point of time, abs(current) must be less than or equal to currentBound
    assessment "currentTimeThreshold": At any point of time, if abs(current)>=currentBoundTimed becomes true and stays true for at least 0.5 then, starting from end of min-time, with no delay, abs(current)<currentBoundTimed must be true
      current: signal closedLoop_tuned_temporalAssessments_Harness/closedLoop_tuned|closedLoop_tuned/Plant/Subsystem/PS-Simulink Converter, port 1
      currentBound: expression 0.015
      currentBoundTimed: expression 0.010