# Requirement set currentRequirements (R2019a)

## 1 [#1] Current Threshold
The absolute value of the current should never exceed 0.015 A.

## 2 [#2] Current Time
The absolute value of the current should never exceed 0.010 A for more than 0.5 s.

## 3 [#3] Convergence
The error between the reference angular trajectory and the robot joint position should be within given bounds.