% Requirement links of closedLoop_tuned.slx (R2019a)

block :4342 implements currentRequirements.slreqx#1: Current Threshold
block :4342 implements currentRequirements.slreqx#2: Current Time
block :4342 implements currentRequirements.slreqx#3: Convergence